# Grasshopper definition test_gpu.gh (Grasshopper 1.0.7)
# plug-ins: GpuComputingTest

series = Series(Start=0, Step=Slider(0.001, range=0..0.001), Count=Slider(10000, range=1..10000))

# ---- group: GPUで計算
g_avr = GpuComputingTest(Num=series)
panel = Panel(g_avr)

g_sum = GpuSum(Num=series)
panel_2 = Panel(g_sum)

# ---- group: ghのコンポーネント
avr = Average(Input=series)
# 平均の計算
panel_3 = Panel(avr)

ma = MassAddition(Input=series)  # -> Result, PartialResults
# 合計の計算
panel_4 = Panel(ma.Result)
